# Dynamo graph Pipes Opening Genrator V 1.45.dyn "Pipes Opening Genrator V 1.46" (Dynamo 2.12.1.8246)
# packages: bimorphNodes 4.2.4, Genius Loci 2023.1.23

# group: Walls
boolean = BoolSelector(true)
categories = Categories("OST_Walls")
string_from_object = FromObject(object=categories)
customISelectionFilter = Python(IN[0]=boolean, IN[1]=string_from_object)  # IronPython2
# ---------- customISelectionFilter.python (46 lines) ----------
#Copyright(c) 2017, john pierson
# @60secondrevit, http://sixtysecondrevit.com
#Sometimes a pick selection is better
#Based on a node from Dimitar Venkov

import clr

clr.AddReference("RevitAPIUI")
from  Autodesk.Revit.UI import *

clr.AddReference("RevitServices")
import RevitServices
from RevitServices.Persistence import DocumentManager
doc = DocumentManager.Instance.CurrentDBDocument
uidoc=DocumentManager.Instance.CurrentUIApplication.ActiveUIDocument

clr.AddReference("RevitNodes")
import Revit
clr.ImportExtensions(Revit.Elements)
TaskDialog.Show('Selection For Wall opening','Pick The Wall. in which you want to creat opening ducts , Press finish to complete.')

sel1 = uidoc.Selection
obt1 = Selection.ObjectType.Element
class CustomISelectionFilter(Selection.ISelectionFilter):
	def __init__(self, nom_categorie):
		self.nom_categorie = nom_categorie
	def AllowElement(self, e):
		if e.Category.Name == self.nom_categorie:
			return True
		else:
			return False
	def AllowReference(self, ref, point):
		return true
		
el_ref = sel1.PickObjects(obt1, CustomISelectionFilter(IN[1]), 'Pick elements of category, ' + (IN[1].lower()) + ' Press finish to complete.')
typelist = list()
idlist = list()
for i in el_ref:
	
	try:
		typelist.append(doc.GetElement(i.ElementId))
	except:
		typelist.apped(list())
		

OUT = typelist
# ----------------------------------------
getLocation = Element.GetLocation(element=customISelectionFilter)
string_from_object_2 = FromObject(object=getLocation)
code_block = CodeBlock { 0; 4; }
substring = String.Substring(string=string_from_object_2, startIndex=code_block.out0, length=code_block.out1)
code_block_2 = CodeBlock { "Line"; }
eq = substring == code_block_2
filterByBoolMask = List.FilterByBoolMask(list=customISelectionFilter, mask=eq)
getLocation_2 = Element.GetLocation(element=filterByBoolMask.in)

# group: Test Location
endPoint = Curve.EndPoint(curve=getLocation_2)
X = Point.X(point=endPoint)
Z = Point.Z(point=endPoint)
startPoint = Curve.StartPoint(curve=getLocation_2)
Z_2 = Point.Z(point=startPoint)
X_2 = Point.X(point=startPoint)
Y = Point.Y(point=endPoint)
Y_2 = Point.Y(point=startPoint)
eq_2 = Y == Y_2
filterByBoolMask_2 = List.FilterByBoolMask(list=filterByBoolMask.in, mask=eq_2)

# group: Seprate Walls X
geometry = Element.Geometry(element=filterByBoolMask_2.in)
isEmpty = List.IsEmpty(list=geometry@L2)
filterByBoolMask_3 = List.FilterByBoolMask(list=filterByBoolMask_2.in, mask=isEmpty)

# group: Curtin Wall X
flatten = List.Flatten(list=filterByBoolMask_3.in)
getLocation_3 = Element.GetLocation(element=flatten)
ZAxis = Vector.ZAxis()
code_block_3 = CodeBlock { "Unconnected Height"; }
getParameterValueByName = Element.GetParameterValueByName(element=flatten, parameterName=code_block_3)
code_block_4 = CodeBlock(a=getParameterValueByName) { a+2000; }
extrude = Curve.Extrude(curve=getLocation_3, direction=ZAxis, distance=code_block_4)
code_block_5 = CodeBlock { 26; }
code_block_6 = CodeBlock { true; }
thicken = Surface.Thicken(surface=extrude, thickness=code_block_5, both_sides=code_block_6)

# group: X Curtain
list_create = List.Create(item0=flatten)
flatten_2 = List.Flatten(list=list_create)
list_create_2 = List.Create(item0=thicken)
flatten_3 = List.Flatten(list=list_create_2)

# group: PIPE CATEGORY
categories_2 = Categories("OST_RvtLinks")
all_elements_of_category = ElementsOfCategory(Category=categories_2)
categories_3 = Categories("OST_PipeCurves")
ofCategory = Revit.LinkElement.OfCategory(linkInstance=all_elements_of_category, category=categories_3)
flatten_4 = List.Flatten(list=ofCategory)
element_geometry_pipe = Element.Geometry(element=flatten_4)
flatten_5 = List.Flatten(list=element_geometry_pipe)

# group: Wall Voids
list_create_3 = List.Create(item0=flatten_5)
flatten_6 = List.Flatten(list=list_create_3)
list_clean = Custom[List Clean](list=flatten_6)  # package Genius Loci; Removes all Null, Empty and Blank from a list or nested list of lists.

# group: Links
list_create_4 = List.Create(item0=flatten_4)
flatten_7 = List.Flatten(list=list_create_4)
list_clean_2 = Custom[List Clean](list=flatten_7)

# group: X , Y Glitch Electrical Fixtures
doesIntersect = Geometry.DoesIntersect(geometry=list_clean, other=flatten_3@L1)
anyTrue = List.AnyTrue(list=doesIntersect@L2)
filterByBoolMask_4 = List.FilterByBoolMask(list=flatten_2, mask=anyTrue)
code_block_7 = CodeBlock { 1; }
doesIntersect_2 = Geometry.DoesIntersect(geometry=list_clean, other=flatten_3@L1)
anyTrue_2 = List.AnyTrue(list=doesIntersect_2@L2)
filterByBoolMask_5 = List.FilterByBoolMask(list=flatten_3, mask=anyTrue_2)
doesIntersect_3 = Geometry.DoesIntersect(geometry=list_clean, other=filterByBoolMask_5.in@L1)
filterByBoolMask_6 = List.FilterByBoolMask(list=list_clean, mask=doesIntersect_3@L2)
code_block_8 = CodeBlock { 3; }
filterByBoolMask_7 = List.FilterByBoolMask(list=list_clean_2, mask=doesIntersect_3@L2)
code_block_9 = CodeBlock { 3; }

# group: Data
element = List.Chop(list=filterByBoolMask_4.in, lengths=code_block_7)  # "Wall.Element"
solid = List.Chop(list=filterByBoolMask_5.in, lengths=code_block_7)  # "Wall.Solid"
solid_2 = List.Flatten(list=filterByBoolMask_6.in@L2, amount=code_block_8)  # "Duct.Solid"
element_2 = List.Flatten(list=filterByBoolMask_7.in@L2, amount=code_block_9)  # "Duct.Element"

# group: Wall
flatten_8 = List.Flatten(list=element)

# group: join
intersectAll = Geometry.IntersectAll(geometry=solid, others=solid_2@L1, lacing=CrossProduct)
code_block_10 = CodeBlock { 4; }
flatten_9 = List.Flatten(list=intersectAll@L4, amount=code_block_10)

# group: Points & Solids
centroid = Solid.Centroid(solid=flatten_9)
pruneDuplicates = Point.PruneDuplicates(points=centroid)
geometry_2 = Element.Geometry(element=element_2)
code_block_11 = CodeBlock { 2; }
flatten_10 = List.Flatten(list=geometry_2@L3, amount=code_block_11)

# group: List Order
X_3 = Point.X(point=pruneDuplicates)
sortIndexByValue = List.SortIndexByValue(list=X_3)
reorder = List.Reorder(list=pruneDuplicates@L2, indices=sortIndexByValue@L2)
centroid_2 = Solid.Centroid(solid=flatten_10)
X_4 = Point.X(point=centroid_2)
sortIndexByValue_2 = List.SortIndexByValue(list=X_4)
reorder_2 = List.Reorder(list=element_2@L2, indices=sortIndexByValue_2@L2)

# group: Points
X_5 = Point.X(point=reorder)
Y_3 = Point.Y(point=reorder)
Z_3 = Point.Z(point=reorder)

# group: Gide
string_from_object_3 = FromObject(object=reorder_2)
code_block_12 = CodeBlock(a=string_from_object_3) { a =="LinkElement(Pipe)"; }
code_block_13 = CodeBlock { "Insulation Thickness"; }
getParameterValueByName_2 = Element.GetParameterValueByName(element=reorder_2, parameterName=code_block_13)

# group: Duct Data
code_block_14 = CodeBlock { "Outside Diameter"; }
code_block_15 = CodeBlock { "Width"; }
if_ = RefactoredIf(test=code_block_12, true=code_block_14, false=code_block_15)
getParameterValueByName_3 = Element.GetParameterValueByName(element=reorder_2, parameterName=if_)
list_clean_3 = Custom[List Clean](list=getParameterValueByName_3)
code_block_16 = CodeBlock { 5; 20; }
if_2 = RefactoredIf(test=code_block_12, true=code_block_16.out0, false=code_block_16.out1)
code_block_17 = CodeBlock(a=getParameterValueByName_2, z=if_2) { a+z; }
code_block_18 = CodeBlock { "Height"; }
if_3 = RefactoredIf(test=code_block_12, true=code_block_14, false=code_block_18)
getParameterValueByName_4 = Element.GetParameterValueByName(element=reorder_2, parameterName=if_3)
list_clean_4 = Custom[List Clean](list=getParameterValueByName_4)

# group: Get Dimntions
code_block_19 = CodeBlock(w=list_clean_3, a=code_block_17) { w+(a*2); }
code_block_20 = CodeBlock(h=list_clean_4, a=code_block_17) { h+(a*2); }

# group: X Coordinate
code_block_21 = CodeBlock(x=X_5, w=code_block_19) { x+w/2; x; }
code_block_22 = CodeBlock { 1; }
flatten_11 = List.Flatten(list=code_block_21.out0@L2, amount=code_block_22)

# group: Y Coordinate
code_block_23 = CodeBlock(y=Y_3) { y; }
code_block_24 = CodeBlock { 1; }
flatten_12 = List.Flatten(list=code_block_23@L2, amount=code_block_24)

# group: Z Coordinate
code_block_25 = CodeBlock(z=Z_3, h=code_block_20) { z+h/2; h; }
code_block_26 = CodeBlock { "z has no if"; }

# group: Point 1
byCoordinates = Point.ByCoordinates(x=flatten_11, y=flatten_12, z=code_block_25.out0)

# group: X Coordinate
code_block_27 = CodeBlock(x=X_5, w=code_block_19) { x-w/2; x; }
code_block_28 = CodeBlock { 1; }
flatten_13 = List.Flatten(list=code_block_27.out0@L2, amount=code_block_28)

# group: Y Coordinate
code_block_29 = CodeBlock(y=Y_3) { y; }
code_block_30 = CodeBlock { 1; }
flatten_14 = List.Flatten(list=code_block_29@L2, amount=code_block_30)

# group: Z Coordinate
code_block_31 = CodeBlock(z=Z_3, h=code_block_20) { z-h/2; h; }
code_block_32 = CodeBlock { "z has no if"; }

# group: Point 2
byCoordinates_2 = Point.ByCoordinates(x=flatten_13, y=flatten_14, z=code_block_31.out0)

# group: Opening Wall
wall = Hood.Opening.Wall(wall=flatten_8, point1=byCoordinates, point2=byCoordinates_2)

# group: Seprate Walls Y
geometry_3 = Element.Geometry(element=filterByBoolMask_2.out)
isEmpty_2 = List.IsEmpty(list=geometry_3@L2)
filterByBoolMask_8 = List.FilterByBoolMask(list=filterByBoolMask_2.out, mask=isEmpty_2)

# group: Curtin Wall Y
flatten_15 = List.Flatten(list=filterByBoolMask_8.in)
getLocation_4 = Element.GetLocation(element=flatten_15)
ZAxis_2 = Vector.ZAxis()
code_block_33 = CodeBlock { "Unconnected Height"; }
getParameterValueByName_5 = Element.GetParameterValueByName(element=flatten_15, parameterName=code_block_33)
code_block_34 = CodeBlock(a=getParameterValueByName_5) { a+2000; }
extrude_2 = Curve.Extrude(curve=getLocation_4, direction=ZAxis_2, distance=code_block_34)
code_block_35 = CodeBlock { 26; }
code_block_36 = CodeBlock { true; }
thicken_2 = Surface.Thicken(surface=extrude_2, thickness=code_block_35, both_sides=code_block_36)

# group: Y Curtain
list_create_5 = List.Create(item0=flatten_15)
flatten_16 = List.Flatten(list=list_create_5)
list_create_6 = List.Create(item0=thicken_2)
flatten_17 = List.Flatten(list=list_create_6)

# group: X , Y Glitch Electrical Fixtures
doesIntersect_4 = Geometry.DoesIntersect(geometry=list_clean, other=flatten_17@L1)
anyTrue_3 = List.AnyTrue(list=doesIntersect_4@L2)
filterByBoolMask_9 = List.FilterByBoolMask(list=flatten_16, mask=anyTrue_3)
code_block_37 = CodeBlock { 1; }
doesIntersect_5 = Geometry.DoesIntersect(geometry=list_clean, other=flatten_17@L1)
anyTrue_4 = List.AnyTrue(list=doesIntersect_5@L2)
filterByBoolMask_10 = List.FilterByBoolMask(list=flatten_17, mask=anyTrue_4)
doesIntersect_6 = Geometry.DoesIntersect(geometry=list_clean, other=filterByBoolMask_10.in@L1)
filterByBoolMask_11 = List.FilterByBoolMask(list=list_clean, mask=doesIntersect_6@L2)
code_block_38 = CodeBlock { 3; }
filterByBoolMask_12 = List.FilterByBoolMask(list=list_clean_2, mask=doesIntersect_6@L2)
code_block_39 = CodeBlock { 3; }

# group: Data
element_3 = List.Chop(list=filterByBoolMask_9.in, lengths=code_block_37)  # "Wall.Element"
solid_3 = List.Chop(list=filterByBoolMask_10.in, lengths=code_block_37)  # "Wall.Solid"
solid_4 = List.Flatten(list=filterByBoolMask_11.in@L2, amount=code_block_38)  # "Duct.Solid"
element_4 = List.Flatten(list=filterByBoolMask_12.in@L2, amount=code_block_39)  # "Duct.Element"

# group: Wall
flatten_18 = List.Flatten(list=element_3)

# group: join
intersectAll_2 = Geometry.IntersectAll(geometry=solid_3, others=solid_4@L1, lacing=CrossProduct)
code_block_40 = CodeBlock { 4; }
flatten_19 = List.Flatten(list=intersectAll_2@L4, amount=code_block_40)

# group: Points & Solids
centroid_3 = Solid.Centroid(solid=flatten_19)
pruneDuplicates_2 = Point.PruneDuplicates(points=centroid_3)
geometry_4 = Element.Geometry(element=element_4)
code_block_41 = CodeBlock { 2; }
flatten_20 = List.Flatten(list=geometry_4@L3, amount=code_block_41)

Y_4 = Point.Y(point=pruneDuplicates_2)

# group: List Order
sortIndexByValue_3 = List.SortIndexByValue(list=Y_4)
reorder_3 = List.Reorder(list=pruneDuplicates_2@L2, indices=sortIndexByValue_3@L2)
centroid_4 = Solid.Centroid(solid=flatten_20)
Y_5 = Point.Y(point=centroid_4)
sortIndexByValue_4 = List.SortIndexByValue(list=Y_5)
reorder_4 = List.Reorder(list=element_4@L2, indices=sortIndexByValue_4@L2)

# group: Points
X_6 = Point.X(point=reorder_3)
Y_6 = Point.Y(point=reorder_3)
Z_4 = Point.Z(point=reorder_3)

# group: X Coordinate
code_block_42 = CodeBlock(x=X_6) { x; }
code_block_43 = CodeBlock { 1; }
flatten_21 = List.Flatten(list=code_block_42@L2, amount=code_block_43)

# group: Gide
string_from_object_4 = FromObject(object=reorder_4)
code_block_44 = CodeBlock(a=string_from_object_4) { a =="LinkElement(Pipe)"; }
code_block_45 = CodeBlock { "Insulation Thickness"; }
getParameterValueByName_6 = Element.GetParameterValueByName(element=reorder_4, parameterName=code_block_45)

# group: Duct Data
code_block_46 = CodeBlock { "Outside Diameter"; }
code_block_47 = CodeBlock { "Width"; }
if_4 = RefactoredIf(test=code_block_44, true=code_block_46, false=code_block_47)
getParameterValueByName_7 = Element.GetParameterValueByName(element=reorder_4, parameterName=if_4)
list_clean_5 = Custom[List Clean](list=getParameterValueByName_7)
code_block_48 = CodeBlock { 5; 20; }
if_5 = RefactoredIf(test=code_block_44, true=code_block_48.out0, false=code_block_48.out1)
code_block_49 = CodeBlock(a=getParameterValueByName_6, z=if_5) { a+z; }
code_block_50 = CodeBlock { "Height"; }
if_6 = RefactoredIf(test=code_block_44, true=code_block_46, false=code_block_50)
getParameterValueByName_8 = Element.GetParameterValueByName(element=reorder_4, parameterName=if_6)
list_clean_6 = Custom[List Clean](list=getParameterValueByName_8)

# group: Get Dimntions
code_block_51 = CodeBlock(w=list_clean_5, a=code_block_49) { w+(a*2); }
code_block_52 = CodeBlock(h=list_clean_6, a=code_block_49) { h+(a*2); }

# group: Z Coordinate
code_block_53 = CodeBlock { "z has no if"; }
code_block_54 = CodeBlock(z=Z_4, h=code_block_52) { z-h/2; h; }

# group: Y Coordinate
code_block_55 = CodeBlock(y=Y_6, l=code_block_51) { y+l/2; y; }
code_block_56 = CodeBlock { 1; }
flatten_22 = List.Flatten(list=code_block_55.out0@L2, amount=code_block_56)

# group: Z Coordinate
code_block_57 = CodeBlock(z=Z_4, h=code_block_52) { z+h/2; h; }
code_block_58 = CodeBlock { "z has no if"; }

# group: Point 1
byCoordinates_3 = Point.ByCoordinates(x=flatten_21, y=flatten_22, z=code_block_57.out0)

# group: X Coordinate
code_block_59 = CodeBlock(x=X_6) { x; }
code_block_60 = CodeBlock { 1; }
flatten_23 = List.Flatten(list=code_block_59@L2, amount=code_block_60)

# group: Y Coordinate
code_block_61 = CodeBlock(y=Y_6, l=code_block_51) { y-l/2; y; }
code_block_62 = CodeBlock { 1; }
flatten_24 = List.Flatten(list=code_block_61.out0@L2, amount=code_block_62)

# group: Point 2
byCoordinates_4 = Point.ByCoordinates(x=flatten_23, y=flatten_24, z=code_block_54.out0)

# group: Opening Wall
wall_2 = Hood.Opening.Wall(wall=flatten_18, point1=byCoordinates_3, point2=byCoordinates_4)

categories_4 = Categories("OST_Walls")
string_from_object_5 = FromObject(object=categories_4)
customISelectionFilter_2 = Python(IN[1]=string_from_object_5)  # IronPython2; unwired: IN[0]; same code as customISelectionFilter
